# Grasshopper definition rnd_node3.gh (Grasshopper 1.0.7)

# ---- group: RH_IN:radius
radius = Slider(40, range=5..80)

# ---- group: RH_IN:count1
count1 = Slider(20, range=2..20)

# ---- group: RH_IN:count2
count2 = Slider(20, range=2..20)

# ---- group: SURFACE
srf = Surface(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)

# ---- group: Base Voronoi
popgeo = PopulateGeometry(Geometry=srf, Count=radius, Seed=1)
bbox = BoundingBox(Content=srf, Plane=PlaneXY(0, 0, 0))  # -> Box, Box_2
volume = Volume(Geometry=bbox.Box)  # -> Volume, Centroid
graft = GraftTree(Tree=popgeo, IncludeEmptyLists=True, IncludeNullItems=True)
scale = Scale(Geometry=bbox.Box, Center=volume.Centroid, Factor=1.1)  # -> Geometry, Transform
srf_cp = SurfaceClosestPoint(Point=graft, Surface=srf)  # -> Point, UVPoint, Distance
voronoi³ = Voronoi3D(Points=popgeo, Box=scale.Geometry)  # -> Cells, Boundary
evalsrf = EvaluateSurface(Surface=srf, Point=srf_cp.UVPoint)  # -> Point, Normal, Frame
bbx = BrepBrep(BrepA=srf, BrepB=voronoi³.Cells)  # -> Curves, Points

# ----
construct_point = ConstructPoint(XCoordinate=count1, YCoordinate=count2, ZCoordinate=0)
evaluate_surface = EvaluateSurface(Surface=srf, Point=construct_point)  # -> Point, Normal, UDirection, VDirection, Frame

# ---- group: Attractor Points
pt = Point(evaluate_surface.Point)
sph = Sphere(Base=pt, Radius=5)

# ----
preview = CustomPreview(Geometry=sph, Shader=ColourSwatch(SwatchColor=RGB(235, 235, 235)))
flatten = FlattenTree(Tree=bbx.Curves, Path="{0}")
disc = Discontinuity(Curve=flatten, Level=1)  # -> Points, Parameters
avr = Average(Input=disc.Points)
pull = PullPoint(Point=avr, Geometry=pt, ClosestOnly=True)  # -> ClosestPoint, Distance

# ---- group: Scaling Factor
bnd = Bounds(Numbers=flatten(pull.Distance))
dom = ConstructDomain(DomainStart=Slider(0.3, range=0.1..1), DomainEnd=Slider(0.98, range=0.1..1))
remap = RemapNumbers(Value=pull.Distance, Source=bnd, Target=dom)  # -> Mapped, Clipped

# ---- group: Extrusion Height
bnd_2 = Bounds(Numbers=flatten(pull.Distance))
dom_2 = ConstructDomain(DomainStart=Slider(25, range=0..50), DomainEnd=Slider(2, range=0..50))
remap_2 = RemapNumbers(Value=pull.Distance, Source=bnd_2, Target=dom_2)  # -> Mapped, Clipped

# ---- group: Extrusion End in Space
amp = Amplitude(Vector=evalsrf.Normal, Amplitude=remap_2.Mapped)
move = Move(Geometry=evalsrf.Frame, Motion=amp)  # -> Geometry, Transform
move_2 = Move(Geometry=bbx.Curves, Motion=amp)  # -> Geometry, Transform
scale_2 = Scale(Geometry=move_2.Geometry, Center=move.Geometry, Factor=remap.Mapped)  # -> Geometry, Transform

# ---- group: Surface between base Voronoi Cell and Extrusion End
loft = Loft(
    Curves=[bbx.Curves, scale_2.Geometry],
    Options={Adjust=False, Closed=False, LoftEnds=0, LoftSimp=0, LoftType=0, Rebuild=10, Refit=0.01})

# ---- group: RH_OUT:mesh
mesh = Mesh(flatten(loft))
